# Grasshopper definition GraFit Network Components Example.gh (Grasshopper 1.0.7)
# plug-ins: Human, GraFitNodes

crv = Curve([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])
crv_2 = Curve([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])
crv_3 = Curve([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])
crv_4 = Curve([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])
crv_5 = Curve([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])
explode = Explode(Curve=crv_3, Recursive=True)  # -> flatten(Segments), Vertices
line = Line(flatten(explode.Segments))
toggle = BooleanToggle(False)
buildgraph = BuildGraph(
    Lines=line,
    LengthCoefficient=Slider(1, range=0..1),
    AngleCoefficient=Slider(1, range=0..1),
    CustomCoefficient=0,
    GPU=toggle)  # -> Graph, Nodes, Edges
panel = Panel("""0
19
1""")
panel_2 = Panel("""10
9
11
26
22""")
c_all_nodes = CSharpScript(nodes=buildgraph.Nodes)  # -> out, A; inputs nodes: list of Int32
# ---------- c_all_nodes: C# usings ----------
using System.Linq;
# ---------- c_all_nodes: C# ----------
    A = nodes.Select((s, i) => i);
# ---------- end c_all_nodes ----------
number_slider = Slider(2, range=0..2)
destination = Point(Point(31.87925625, 54.27091338, 0))
origin = Point(Point(7.457748683, 20.30722736, 0))
cp = ClosestPoint(Point=origin, Cloud=buildgraph.Nodes)  # -> ClosestPoint, CPIndex, Distance
cp_2 = ClosestPoint(Point=destination, Cloud=buildgraph.Nodes)  # -> ClosestPoint, CPIndex, Distance
to = Integer(panel_2)
from = Integer(panel)
c_test_matrix = CSharpScript(From=from, To=to)  # -> out, DistanceMatrix; inputs From: list of Int32, To: list of Int32
# ---------- c_test_matrix: C# usings ----------
//using Grafit;
//using GrafitRhino;
using System.Linq;
# ---------- c_test_matrix: C# ----------
    int FromN = From.Count;
    int ToN = To.Count;

    var reducedODMatrix = new Matrix(FromN, ToN);

    for(int i = 0; i < FromN; i++)
    {
      for(int j = 0; j < ToN; j++)
      {
        reducedODMatrix[i, j] = 1;
      }
      reducedODMatrix[i, i] = 0;
    }



    DistanceMatrix = reducedODMatrix;

    return;
# ---------- end c_test_matrix ----------
getshortestpath = GetShortestPath(Graph=buildgraph.Graph, Origin=cp.CPIndex, Destination=cp_2.CPIndex)  # -> Metric, Angle, Custom, Nodes, Edges
getweightmatrix = GetWeightMatrix(Graph=buildgraph.Graph, WeightMatrixIndex=number_slider)
points = PointList(Points=buildgraph.Nodes)
c_script = CSharpScript(directedEdges=buildgraph.Edges)  # -> out, A; inputs directedEdges: list of Line
# ---------- c_script: C# ----------
    var lines = directedEdges.Take(directedEdges.Count() / 2).ToList();
    var translatedLines = new Line[lines.Count * 2];
    int index = 0;
    double distance = 0.05;



    foreach (Line line in lines)
    {
      Point3d midpoint = line.PointAt(0.5);
      Vector3d tangent = line.UnitTangent;
      Vector3d normal = Vector3d.CrossProduct(tangent, Vector3d.ZAxis);
      normal *= distance;
      Point3d start = line.From + normal;
      Point3d end = line.To + normal;
      Line translatedLine = new Line(start, end);

      translatedLines[index] = new Line(start, end);
      index++;
    }

    foreach (Line line in lines)
    {
      line.Flip();
      Point3d midpoint = line.PointAt(0.5);
      Vector3d tangent = line.UnitTangent;
      Vector3d normal = Vector3d.CrossProduct(tangent, Vector3d.ZAxis);
      normal *= distance;
      Point3d start = line.From + normal;
      Point3d end = line.To + normal;
      Line translatedLine = new Line(start, end);

      translatedLines[index] = new Line(start, end);
      index++;
    }


    A = translatedLines;
# ---------- end c_script ----------
getgraphmeasures = GetGraphMeasures(
    Graph=buildgraph.Graph,
    WeightMatrixIndex=number_slider,
    ODWeightMatrix=c_test_matrix.DistanceMatrix,
    Origins=from,
    Destinations=to,
    GPU=toggle)  # -> BCN, BCE, CCN, CCE

# ---- group: Edges
values_num_edges = Number(getgraphmeasures.BCE)
lines_crv = Curve(c_script.A)
log = Logarithm(Value=values_num_edges)
bnd = Bounds(Numbers=log)
remap = RemapNumbers(Value=log, Source=bnd, Target=Domain(0, 1))  # -> Mapped, Clipped
gradient = Gradient(
    LowerLimit=0,
    UpperLimit=1,
    Parameter=remap.Mapped,
    stops=[0: RGB(0, 0, 139), 0.221: RGB(50, 178, 206), 0.709: RGB(255, 215, 0), 1: RGB(255, 0, 0)])
previewlw = CustomPreviewLineweights(Geometry=lines_crv, Shader=gradient, Thickness=Slider(5, range=0..10), Absolute=False)

# ---- group: Nodes
values_num_nodes = Number(getgraphmeasures.BCN)
log_2 = Logarithm(Value=values_num_nodes)
bnd_2 = Bounds(Numbers=log_2)
remap_2 = RemapNumbers(Value=log_2, Source=bnd_2, Target=Domain(0, 1))  # -> Mapped, Clipped
gradient_2 = Gradient(
    LowerLimit=0,
    UpperLimit=1,
    Parameter=remap_2.Mapped,
    stops=[0: RGB(0, 0, 139), 0.221: RGB(50, 178, 206), 0.709: RGB(255, 215, 0), 1: RGB(255, 0, 0)])
symsim = SymbolSimple(Style=5, Size=Slider(6, range=0..10), Rotation=0, Colour=gradient_2)
symbol = SymbolDisplay(Location=buildgraph.Nodes, Display=symsim)

# ----
pointspath = Data(getshortestpath.Nodes)
linespath = Data(getshortestpath.Edges)
swatch = ColourSwatch(SwatchColor=RGB(84, 199, 116))
item = ListItem(List=buildgraph.Edges, Index=linespath, Wrap=True)
item_2 = ListItem(List=buildgraph.Nodes, Index=pointspath, Wrap=True)
symsim_2 = SymbolSimple(Style=7, Size=12, Rotation=0, Colour=swatch)
previewlw_2 = CustomPreviewLineweights(Geometry=item, Shader=swatch, Thickness=Slider(5, range=0..10), Absolute=False)
symbol_2 = SymbolDisplay(Location=item_2, Display=symsim_2)
