# Grasshopper definition GraFit Network Example.gh (Grasshopper 1.0.7)
# plug-ins: Human, ScriptParasite

panel = Panel("C:\Users\fesmc\AppData\Roaming\Grasshopper\Libraries\GrasshopperScripts")
c_functions = CSharpScript(Reference=["C:\Users\fesmc\AppData\Roaming\Grasshopper\Libraries\Grafit\GraFit.dll", "C:\Users\fesmc\AppData\Roaming\Grasshopper\Libraries\Grafit\GraFitRhino.dll"])  # -> out, F1_CreateDualGraph, F2_CreatePrimalDirectedGraph, F3_GetShortestPath, F4_GetGeometry, F5_GetWeightMatrixAsMatrix, F6_GetWeightMatrixAsLists, F7_CalculateCentralities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
# ---------- c_functions: C# usings ----------
using Grafit;
using GrafitRhino;
using System.Linq;
# ---------- c_functions: C# ----------
    //delegate V MyDelegate<T,U,V>(T input, out U output);
    Func < List < Line>, int, bool, dynamic> f1 = f1_CreateDualGraph;
    Func < List < Line>, int, bool, List < double>, List < double>, dynamic> f2 = f2_CreatePrimalDirectedGraph;

    Func < object, int, int, dynamic> f3 = f3_GetShortestPath;
    Func < object, dynamic> f4 = f4_GetGeometry;
    Func < object, int, dynamic> f5 = f5_GetWeightMatrixAsMatrix;
    Func < object, int, dynamic> f6 = f6_GetWeightMatrixAsLists;

    Func < object, List < int>, List < int>, dynamic, bool, bool, dynamic> f7 = f7_CalculateCentralities; //object Graph, List<int> From, List<int> To, List<double> ODWeightMatrix, bool Directed
    Func < object, dynamic> f8 = f8_GetNextMatrix;
    Func < object, dynamic> f9 = f9_GetDisconnectedPartsDual;
    Func < object, dynamic> f10 = f10_GetDisconnectedPartsPrimal;
    Func < object, int, int, int[], double[], int, bool, bool, dynamic> f11 = f11_AlternativeShortestPaths;

    F1_CreateDualGraph = f1;
    F2_CreatePrimalDirectedGraph = f2;
    F3_GetShortestPath = f3;
    F4_GetGeometry = f4;
    F5_GetWeightMatrixAsMatrix = f5;
    F6_GetWeightMatrixAsLists = f6;
    F7_CalculateCentralities = f7;
    F8_GetNextMatrix = f8;
    F9_GetDisconnectedPartsDual = f9;
    F10_GetDisconnectedPartsPrimal = f10;
    F11_AlternativeShortestPaths = f11;
# ---------- c_functions: C# additional code ----------
  //----------------------------------------------------------------------------------------------
  public static dynamic f1_CreateDualGraph(List<Line> LineGeometry, int WeightMatrixIdx, bool GPU)
  {

    CPrimalDirectedGraph<Point3d, Line> primalGraph;
    CDualUndirectedGraph<Point3d, Line> dualGraph;

    {
      double[] edgeLengths;

      var graphElements = GeometryToGraphElements<Point3d, Line>.GetNodesAndEdgesFromLines(LineGeometry.Select(s => new CWLine(s)),
        out edgeLengths);

      primalGraph = new CPrimalDirectedGraph<Point3d, Line>(graphElements);
      primalGraph.AddWeightMatrix(edgeLengths); // index 0
      primalGraph.AddEmptyWeightMatrix(); // index 1 - angles

      for (int i = 0; i < primalGraph.UndirectedEdges.Count; i++)
      {
        var n1 = primalGraph.UndirectedEdges[i][0];
        var n2 = primalGraph.UndirectedEdges[i][1];

        primalGraph.SetWeightMatrixAndEdgeValue(0.0, n1, n2, 1);
        primalGraph.SetWeightMatrixAndEdgeValue(0.0, n2, n1, 1);

      }
    }

    

    {
      double[] edgeAngles;
      double[] edgeLengths;

      var graphElements = GeometryToGraphElements<Point3d, Line>.GetDualNodesAndEdgesFromPrimalGraph(primalGraph,
        out edgeLengths, out edgeAngles);

      dualGraph = new CDualUndirectedGraph<Point3d, Line>(primalGraph, graphElements);

      dualGraph.AddWeightMatrix(edgeLengths); // index 0
      dualGraph.AddWeightMatrix(edgeAngles);  // index 1


      //foreach (var edge in dualGraph.UndirectedEdges)
      //{
      //  var prim_edge_id_0 = edge[0];
      //  var prim_edge_id_1 = edge[1];

      //  var e0n1 = dualGraph.Nodes[prim_edge_id_0].PrimId1; // primal node from of edge 0
      //  var e0n2 = dualGraph.Nodes[prim_edge_id_0].PrimId2; // primal node to of edge 0

      //  var e1n1 = dualGraph.Nodes[prim_edge_id_1].PrimId1;   // primal node from of edge 1
      //  var e1n2 = dualGraph.Nodes[prim_edge_id_1].PrimId2;   // primal node to of edge 2

          //var some_weight = 0;
          //var weight_matrix_index = 2;
          //dualGraph.SetWeightMatrixValue(some_weight, prim_edge_id_0, prim_edge_id_1, weight_matrix_index);
      //}

      //dualGraph.APShortestPathsByManyWeights(0, 1, GPU);
      dualGraph.APShortestPathsByOneWeight(WeightMatrixIdx, GPU);
    }


    return new dynamic[1] { dualGraph }; ;
  }

  //----------------------------------------------------------------------------------------------
  public static dynamic f2_CreatePrimalDirectedGraph(List<Line> LineGeometry, int WeightMatrixIdx, bool GPU, List<double> weights1, List<double> weights2)
  {

    double[] edgeLengths;

    var graphElements = GeometryToGraphElements<Point3d, Line>.GetNodesAndEdgesFromLines(LineGeometry.Select(s => new CWLine(s)),
      out edgeLengths);



    var graph = new CPrimalDirectedGraph<Point3d, Line>(graphElements);
    graph.AddWeightMatrix(edgeLengths); // index 0
    graph.AddEmptyWeightMatrix(); // index 1

    for (int i = 0; i < graph.UndirectedEdges.Count; i++)
    {
      var n1 = graph.UndirectedEdges[i][0];
      var n2 = graph.UndirectedEdges[i][1];

      graph.SetWeightMatrixValue(weights1[i], n1, n2, 1);
      graph.SetWeightMatrixValue(weights2[i], n2, n1, 1);

    }

    //graph.APShortestPathsByManyWeights(0, 1, GPU);
    graph.APShortestPathsByOneWeight(WeightMatrixIdx, GPU);

    return graph;
  }
  //----------------------------------------------------------------------------------------------
  public static dynamic[] f3_GetShortestPath(object Graph, int Origin, int Destination)
  {
    var graph = Graph as AGraph;

    List<int> PathEdgesIds;
    List<int> PathNodesIds;


    //graph.GetShortestPathNodeIds(Origin, Destination, out PathNodesIds);
    bool isDirected = true;
    
    graph.GetShortestPathEdgeIds(Origin, Destination, isDirected, out PathNodesIds, out PathEdgesIds);

    var NodesPath = PathNodesIds;
    var EdgesPath = PathEdgesIds;


    var CostDistance = graph.GetShortestPathDistance(Origin, Destination, 0);
    var FilterDistance = graph.GetShortestPathDistance(Origin, Destination, 1);

    return new dynamic[4] { NodesPath, EdgesPath, CostDistance, FilterDistance };

  }
  //----------------------------------------------------------------------------------------------
  public static dynamic[] f4_GetGeometry(object Graph)
  {
    var graph = Graph as ISpatialGraph<AWPoint<Point3d>, AWLine<Point3d, Line>, Point3d, Line>;

    if (Graph is CDualUndirectedGraph<Point3d, Line>)
    {
      var graph_dual = Graph as CDualUndirectedGraph<Point3d, Line>;
      graph = graph_dual.PrimalDirectedGraph;
    }

    var NodeAsPoints = graph.NodesGeometryList.Select(s => s.Internal);
    var EdgesDirected = graph.GenerateDirectedEdgeGeometry(CWLine.LineFromPoints).Select(s => s.Internal);
    var EdgesUndirected = graph.GenerateUndirectedEdgeGeometry(CWLine.LineFromPoints).Select(s => s.Internal);

    return new dynamic[3] { NodeAsPoints, EdgesDirected, EdgesUndirected };
  }

  //----------------------------------------------------------------------------------------------
  public static dynamic f5_GetWeightMatrixAsMatrix(object Graph, int WeightMatrixIndex)
  {
    var n = (Graph as IMeasurableGraph).NodesCountMeasure;
    var dm = (Graph as AGraph).GetWeigthMatrixById(WeightMatrixIndex);

    return GraFitRhino.GrafitRhinoUtils.Get1DDoubleArrayAsMatrix(dm);
  }

  //----------------------------------------------------------------------------------------------
  public static dynamic f6_GetWeightMatrixAsLists(object Graph, int WeightMatrixIndex)
  {
    var n = (Graph as IMeasurableGraph).NodesCountMeasure;
    var dm = (Graph as AGraph).GetWeigthMatrixById(WeightMatrixIndex);

    return GraFitRhino.GrafitRhinoUtils.Get1DDoubleArrayAsListList(dm);
  }
  //----------------------------------------------------------------------------------------------
  public static dynamic[] f7_CalculateCentralities(object Graph, List<int> From, List<int> To, dynamic ODWeightMatrixReduced,
  bool Directed, bool GPU = true)
  {
  var graph = Graph as IMeasurableGraph;
  var n = graph.NodesCountMeasure;

  var odRhinoMatrix = ODWeightMatrixReduced as Matrix;

  var odwm = new double[n * n]; // filled with 0s

  for (int i = 0; i < From.Count; i++)
  for (int j = 0; j < To.Count; j++)
  {
  odwm[From[i] * n + To[j]] = odRhinoMatrix[i, j];
}

    //for (int i = 0; i < n * n; i++)
    //{
    //  odwm[i] = 1;
    //}

    var measurement = new CMeasure(graph);
    measurement.UseDirectedEdges = Directed;

    if (GPU)
      measurement.CalculateBCGPU(odwm); //only for Primal Directed Graph
    else
      measurement.CalculateBC(odwm);

    //here 0 is the filterMatrixId
    //measurement.CalculateCC(odwm, 0);

    var BCN = measurement.BCNodes;
    var BCE = measurement.BCEdges;

double[] CCN = null; //measurement.CCNodes;
double[] CCE = null; // measurement.CCEdges;

return new dynamic[4] { BCN, BCE, CCN, CCE };

  }

public static dynamic f8_GetNextMatrix(object Graph)
{
  var graph = Graph as IMeasurableGraph;
  var n = graph.NodesCountMeasure;

  return graph.GetNextMatrix1();
}

public static dynamic f9_GetDisconnectedPartsDual(object Graph)
{
  var graph = Graph as CDualUndirectedGraph<Point3d, Line>;

  var undirEdgesCount = graph.PrimalDirectedGraph.UndirectedEdges.Count;

  var undirEdgesDegree = new int[undirEdgesCount];

  for (int i = 0; i < undirEdgesCount; i++)
  {
    for (int j = 0; j < undirEdgesCount; j++)
    {
      if (i == j) continue;

      if (graph.IsAdjacent1st(i, j)) undirEdgesDegree[i]++;
      if (graph.IsAdjacent1st(i, j + undirEdgesCount)) undirEdgesDegree[i]++;
      if (graph.IsAdjacent1st(i + undirEdgesCount, j + undirEdgesCount)) undirEdgesDegree[i]++;
      if (graph.IsAdjacent1st(i + undirEdgesCount, j)) undirEdgesDegree[i]++;
    }
  }

  return undirEdgesDegree;
}

  public static dynamic f10_GetDisconnectedPartsPrimal(object Graph)
  {
    var graph = Graph as CPrimalDirectedGraph<Point3d, Line>;


    List<List<int>> subgraphs = new List<List<int>>();
    bool[] visited = new bool[graph.NodesCount];

    for (int i = 0; i < graph.NodesCount; i++)
    {
      if (!visited[i])
      {
        List<int> subgraph = new List<int>();
        DFS(i, graph.NodesCount, graph.GetWeigthMatrixById(0), visited, subgraph);
        subgraphs.Add(subgraph);
      }
    }

    return subgraphs;
  }

  public static dynamic f11_AlternativeShortestPaths(object Graph, int StartNodeId, int FinishNodeId,
              int[] WeightsIds,
              double[] WeightsTolerance,
              int Limit = 100,
              bool ToleranceOnly = true,
              bool SaveIndividualPaths = false)
  {

    var graph = Graph as AGraph;
    List<List<int>> resultNodes = new List<List<int>>();
    List<List<int>> resultEdges = new List<List<int>>();


    graph.AlternativeShortestPaths(StartNodeId, FinishNodeId, out resultNodes,
            out resultEdges, WeightsIds, WeightsTolerance, Limit, ToleranceOnly, SaveIndividualPaths);


    return new dynamic[2] { resultNodes, resultEdges };
  }

  private static void DFS(int node, int size, double[] distances, bool[] visited, List<int> subgraph)
{
  visited[node] = true;
  subgraph.Add(node);

  for (int i = 0; i < size; i++)
  {
    if (!visited[i] && distances[node * size + i] != double.PositiveInfinity)
    {
      DFS(i, size, distances, visited, subgraph);
    }
  }
}
# ---------- end c_functions ----------
scriptpar = ScriptParasite(Enable=Toggle(True), Folder=panel)

crv = Curve([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])
crv_2 = Curve([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])
crv_3 = Curve([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])
crv_4 = Curve([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])
crv_5 = Curve([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])
explode = Explode(Curve=crv_5, Recursive=True)  # -> flatten(Segments), Vertices
line = Line(flatten(explode.Segments))
weight_matrix_id = Panel("1")
toggle = BooleanToggle(False)
len = Length(Curve=line)
c_f2_primal_directed_graph = CSharpScript(
    LineGeometry=line,
    GPU=toggle,
    f=c_functions.F2_CreatePrimalDirectedGraph,
    w1=len,
    w2=len,
    WeightMatrixIdx=weight_matrix_id)  # -> out, PrimalDirGraph; inputs LineGeometry: list of Line, GPU: Boolean, w1: list of Double, w2: list of Double, WeightMatrixIdx: Int32
# ---------- c_f2_primal_directed_graph: C# usings ----------
using System.Linq;
# ---------- c_f2_primal_directed_graph: C# ----------
    var F = f as  Func < List < Line>, int, bool, List < double>, List < double>, dynamic >;

    PrimalDirGraph = F(LineGeometry, WeightMatrixIdx, GPU, w1, w2);

    return;
# ---------- end c_f2_primal_directed_graph ----------
c_f1_dual_graph = CSharpScript(LineGeometry=line, GPU=toggle, f=c_functions.F1_CreateDualGraph, WeightMatrixIndex=weight_matrix_id)  # -> out, DualGraph; inputs LineGeometry: list of Line, GPU: Boolean, WeightMatrixIndex: Int32
# ---------- c_f1_dual_graph: C# ----------
    var F = f as  Func<List<Line>, int, bool, dynamic >;

    var result = F(LineGeometry, WeightMatrixIndex, GPU);
    DualGraph = result[0];

    return;
# ---------- end c_f1_dual_graph ----------
agraph = Data(c_f1_dual_graph.DualGraph)
panel_2 = Panel("""0
1
2
3
4""")
panel_3 = Panel("""0
1
2
3
4""")
c_f5_get_weight_matrix_as_matrix = CSharpScript(Graph=agraph, f=c_functions.F5_GetWeightMatrixAsMatrix, From=panel_2, To=panel_3, WeightMatrixIndex=weight_matrix_id)  # -> out, DistanceMatrix; inputs From: list of Int32, To: list of Int32, WeightMatrixIndex: Int32
# ---------- c_f5_get_weight_matrix_as_matrix: C# usings ----------
//using Grafit;
//using GrafitRhino;
using System.Linq;
# ---------- c_f5_get_weight_matrix_as_matrix: C# ----------
    var F = f as   Func<object, int, dynamic>;

    var result = F(Graph, WeightMatrixIndex);

    int FromN = From.Count;
    int ToN = To.Count;


    //    DistanceMatrix = result;//reducedODMatrix;

    //    return;

    var reducedODMatrix = new Matrix(FromN, ToN);

    for(int i = 0; i < FromN; i++)
    {
      for(int j = 0; j < ToN; j++)
      {
        var weight = result[From[i], To[j]];
        reducedODMatrix[i, j] = weight;
      }
      reducedODMatrix[i, i] = 0;
    }



    DistanceMatrix = reducedODMatrix;

    return;
# ---------- end c_f5_get_weight_matrix_as_matrix ----------
c_f4_generate_geometry = CSharpScript(Graph=agraph, f=c_functions.F4_GetGeometry)  # -> out, NodeAsPoints, EdgesDirected, EdgesUndirected
# ---------- c_f4_generate_geometry: C# ----------
    var F = f as   Func<object, dynamic>;

    var result = F(Graph); 

    NodeAsPoints = result[0];
    EdgesDirected = result[1];
    EdgesUndirected = result[2];

    return;

    /*
    var graph = Graph as ISpatialGraph<AWPoint<Point3d>, AWLine<Point3d, Line>, Point3d, Line>;

    if(Graph is CDualUndirectedGraph<Point3d, Line>)
    {
      var graph_dual = Graph as CDualUndirectedGraph<Point3d, Line>;
      graph = graph_dual.PrimalDirectedGraph;
    }

    NodeAsPoints = graph.NodesGeometryList.Select(s => s.Internal);
    EdgesDirected = graph.GenerateDirectedEdgeGeometry(CWLine.LineFromPoints).Select(s => s.Internal);
    EdgesUndirected = graph.GenerateUndirectedEdgeGeometry(CWLine.LineFromPoints).Select(s => s.Internal);
 */
# ---------- c_f4_generate_geometry: C# additional code ----------
  public delegate TResult CFunc<in T1, T2, T3, T4, out TResult>(T1 input, out T2 output1, out T3 output2, out T4 output3);
# ---------- end c_f4_generate_geometry ----------
matrix = DisplayMatrix(c_f5_get_weight_matrix_as_matrix.DistanceMatrix)
edgeundirectedlines = Data(c_f4_generate_geometry.EdgesUndirected)
edgedirectedlines = Data(c_f4_generate_geometry.EdgesDirected)
nodepoints = Data(c_f4_generate_geometry.NodeAsPoints)
destination = Point(Point(9.903453048, 0.1610518137, 0))
origin = Point(Point(12.04821472, 4.822563857, 0))
panel_4 = Panel("""4
90.001""")
panel_5 = Panel("""0
1""")
cp = ClosestPoint(Point=origin, Cloud=nodepoints)  # -> ClosestPoint, CPIndex, Distance
cp_2 = ClosestPoint(Point=destination, Cloud=nodepoints)  # -> ClosestPoint, CPIndex, Distance
toggle_directed = BooleanToggle(True)
toggle_gpu = BooleanToggle(True)
c_script = CSharpScript(lines=edgeundirectedlines)  # -> out, A; inputs lines: list of Line
# ---------- c_script: C# ----------
    var translatedLines = new Line[lines.Count * 2];
    int index = 0;
    double distance = 0.05;
 
    foreach (Line line in lines)
    {
      Point3d midpoint = line.PointAt(0.5);
      Vector3d tangent = line.UnitTangent;
      Vector3d normal = Vector3d.CrossProduct(tangent, Vector3d.ZAxis);
      normal *= distance;
      Point3d start = line.From + normal;
      Point3d end = line.To + normal;
      Line translatedLine = new Line(start, end); 

      translatedLines[index] = new Line(start, end);
      index++;
    }

    foreach (Line line in lines)
    {
      line.Flip();
      Point3d midpoint = line.PointAt(0.5);
      Vector3d tangent = line.UnitTangent;
      Vector3d normal = Vector3d.CrossProduct(tangent, Vector3d.ZAxis);
      normal *= distance;
      Point3d start = line.From + normal;
      Point3d end = line.To + normal;
      Line translatedLine = new Line(start, end); 

      translatedLines[index] = new Line(start, end);
      index++;
    }


    A = translatedLines;
# ---------- end c_script ----------
c_f7_calculate_bc_and_cc = CSharpScript(
    Graph=agraph,
    From=panel_2,
    To=panel_3,
    ODWeightMatrixReduced=c_f5_get_weight_matrix_as_matrix.DistanceMatrix,
    Directed=toggle_directed,
    f=c_functions.F7_CalculateCentralities,
    GPU=toggle_gpu)  # -> out, BCN, BCE, CCN, CCE; inputs From: list of Int32, To: list of Int32, Directed: Boolean, GPU: Boolean
# ---------- c_f7_calculate_bc_and_cc: C# ----------
    var F = f as   Func < object, List < int>, List < int>, dynamic, bool, bool, dynamic>;

    var result = F(Graph, From, To, ODWeightMatrixReduced, Directed, GPU);

    BCN = result[0];
    BCE = result[1];

    CCN = result[2];
    CCE = result[3];

    return;

    /*
    var odwm = ODWeightMatrix; // as float[];
    var graph = Graph as IMeasurableGraph;
    var n = graph.NodesCountMeasure;

    var odwmAsArray = new double[n * n];

    for(int i = 0; i < n; i++)
      for(int j = 0; j < n; j++)
      {
        odwmAsArray[i * n + j] = odwm[i * n + j]; //0
      }

    for(int i = 0; i < From.Count; i++)
      for(int j = 0; j < To.Count; j++)
      {
        //odwmAsArray[From[i] * n + To[j]] = odwm[From[i] * n + To[j]];
      }


    var measurement = new CMeasure(graph);
    measurement.UseDirectedEdges = Directed;

    measurement.CalculateBC(odwmAsArray);

    //here 0 is the filterMatrixId
    measurement.CalculateCC(odwmAsArray, 0);

    BCN = measurement.BCNodes;
    BCE = measurement.BCEdges;

    CCN = measurement.CCNodes;
    CCE = measurement.CCEdges;

 */
# ---------- end c_f7_calculate_bc_and_cc ----------
c_f11_get_alternative_paths = CSharpScript(
    Graph=agraph,
    Origin=cp.CPIndex,
    Destination=cp_2.CPIndex,
    f=c_functions.F11_AlternativeShortestPaths,
    WeightIds=panel_5,
    WeightTolerance=panel_4)  # -> out, NodesPath, EdgesPath; inputs Origin: Int32, Destination: Int32, WeightIds: list of Int32, WeightTolerance: list of Double; disabled
# ---------- c_f11_get_alternative_paths: C# ----------
    var F = f as   Func<object, int, int, int[], double[], int, bool, bool, dynamic>;

    int Limit = 800;
    bool ToleranceOnly = true;
    bool SaveIndividualPaths = false;

    var result = F(Graph, Origin, Destination, WeightIds.ToArray(), WeightTolerance.ToArray(), Limit, ToleranceOnly, SaveIndividualPaths);

    DataTree<int> nodesPathTree = new DataTree<int>();
    DataTree<int> edgesPathTree = new DataTree<int>();

    for (int i = 0; i < result[0].Count; i++)
    {
      nodesPathTree.AddRange(result[0][i], new GH_Path(i));
      edgesPathTree.AddRange(result[1][i], new GH_Path(i));
    }

    NodesPath = nodesPathTree;
    EdgesPath = edgesPathTree;



    return;


   /* var graph = Graph as AGraph;

    List <int> PathEdgesIds;
    List <int> PathNodesIds;


    //graph.GetShortestPathNodeIds(Origin, Destination, out PathNodesIds);
    graph.GetShortestPathEdgeIds(Origin, Destination, out PathNodesIds, out PathEdgesIds);

    NodesPath = PathNodesIds;
    EdgesPath = PathEdgesIds;


    CostDistance = graph.GetShortestPathDistance(Origin, Destination, 0);
    FilterDistance = graph.GetShortestPathDistance(Origin, Destination, 1);
*/
# ---------- end c_f11_get_alternative_paths ----------
c_f3_get_shortest_paths = CSharpScript(Graph=agraph, Origin=cp.CPIndex, Destination=cp_2.CPIndex, f=c_functions.F3_GetShortestPath)  # -> out, NodesPath, EdgesPath, DistanceId0, DistanceId1; inputs Origin: Int32, Destination: Int32
# ---------- c_f3_get_shortest_paths: C# ----------
    var F = f as   Func<object, int, int, dynamic>;

    var result = F(Graph, Origin, Destination);

    NodesPath = result[0];
    EdgesPath = result[1];
    DistanceId0 = result[2];
    DistanceId1 = result[3];

    return;


   /* var graph = Graph as AGraph;

    List <int> PathEdgesIds;
    List <int> PathNodesIds;


    //graph.GetShortestPathNodeIds(Origin, Destination, out PathNodesIds);
    graph.GetShortestPathEdgeIds(Origin, Destination, out PathNodesIds, out PathEdgesIds);

    NodesPath = PathNodesIds;
    EdgesPath = PathEdgesIds;


    CostDistance = graph.GetShortestPathDistance(Origin, Destination, 0);
    FilterDistance = graph.GetShortestPathDistance(Origin, Destination, 1);
*/
# ---------- end c_f3_get_shortest_paths ----------
filter = StreamFilter(Gate=toggle_directed, Stream0=edgeundirectedlines, Stream1=c_script.A)
panel_6 = Panel([c_f3_get_shortest_paths.DistanceId0, c_f3_get_shortest_paths.DistanceId1])

# ---- group: Edges
values_num_edges = Number(c_f7_calculate_bc_and_cc.BCE)
lines_crv = Curve(filter)
log = Logarithm(Value=values_num_edges)
bnd = Bounds(Numbers=log)
remap = RemapNumbers(Value=log, Source=bnd, Target=Domain(0, 1))  # -> Mapped, Clipped
gradient = Gradient(
    LowerLimit=0,
    UpperLimit=1,
    Parameter=remap.Mapped,
    stops=[0: RGB(0, 0, 139), 0.221: RGB(50, 178, 206), 0.709: RGB(255, 215, 0), 1: RGB(255, 0, 0)])
previewlw = CustomPreviewLineweights(Geometry=lines_crv, Shader=gradient, Thickness=Slider(5, range=0..10), Absolute=False)

# ---- group: Nodes
values_num_nodes = Number(c_f7_calculate_bc_and_cc.BCN)
log_2 = Logarithm(Value=values_num_nodes)
bnd_2 = Bounds(Numbers=log_2)
remap_2 = RemapNumbers(Value=log_2, Source=bnd_2, Target=Domain(0, 1))  # -> Mapped, Clipped
gradient_2 = Gradient(
    LowerLimit=0,
    UpperLimit=1,
    Parameter=remap_2.Mapped,
    stops=[0: RGB(0, 0, 139), 0.221: RGB(50, 178, 206), 0.709: RGB(255, 215, 0), 1: RGB(255, 0, 0)])
symsim = SymbolSimple(Style=5, Size=Slider(6, range=0..10), Rotation=0, Colour=gradient_2)
symbol = SymbolDisplay(Location=nodepoints, Display=symsim)

# ----
nodespathalternative = Data(c_f11_get_alternative_paths.NodesPath)
edgespathalternative = Data(c_f11_get_alternative_paths.EdgesPath)
nodespath = Data(c_f3_get_shortest_paths.NodesPath)
edgespath = Data(c_f3_get_shortest_paths.EdgesPath)

# ---- group: Get vec Path
item = ListItem(List=edgedirectedlines, Index="0", Wrap=True)
explode_2 = Explode(Curve=item, Recursive=True)  # -> Segments, Vertices
item_2 = ListItem(List=explode_2.Vertices, Index=0, Wrap=True)  # -> Item, Item1
vec2pt = Vector2Pt(PointA=item_2.Item, PointB=item_2.Item1, Unitize=False)  # -> Vector, Length
vdis = VectorDisplay(Anchor=item_2.Item, Vector=vec2pt.Vector)

# ---- group: Dual
pointspath = Data(nodespath)
linespath = Data(edgespath)
swatch = ColourSwatch(SwatchColor=RGB(84, 199, 116))
item_3 = ListItem(List=edgedirectedlines, Index=linespath, Wrap=True)
item_4 = ListItem(List=nodepoints, Index=pointspath, Wrap=True)
symsim_2 = SymbolSimple(Style=7, Size=12, Rotation=0, Colour=swatch)
symbol_2 = SymbolDisplay(Location=item_4, Display=symsim_2)
previewlw_2 = CustomPreviewLineweights(Geometry=item_3, Shader=swatch, Thickness=Slider(5, range=0..10), Absolute=False)

# ---- group: Get vec Path
explode_3 = Explode(Curve=c_script.A, Recursive=True)  # -> Segments, Vertices
item_5 = ListItem(List=explode_3.Vertices, Index=0, Wrap=True)  # -> Item, Item1
vec2pt_2 = Vector2Pt(PointA=item_5.Item, PointB=item_5.Item1, Unitize=False)  # -> Vector, Length
vdis_2 = VectorDisplay(Anchor=item_5.Item, Vector=vec2pt_2.Vector)

# ---- group: Visualisation
eval = EvaluateCurve(Curve=c_script.A, Parameter=Slider(0.5, range=0..1))  # -> Point, Tangent, Angle
points = PointList(Points=eval.Point, Size=Slider(0.07, range=0..1.1))
points_2 = PointList(Points=nodepoints, Size=Slider(0.3, range=0..1))

# ---- group: vector path
item_6 = ListItem(List=edgedirectedlines, Index=linespath, Wrap=True)
end = EndPoints(Curve=item_6)  # -> Start, End
vdis_3 = VectorDisplay(Anchor=end.Start, Vector=item_6)
