# Grasshopper definition GraFit Weight Matrices One Src.gh (Grasshopper 1.0.7)
# plug-ins: Human

crv = Curve([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])
crv_2 = Curve([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])
c_functions = CSharpScript(Reference=["C:\Users\fesmc\AppData\Roaming\Grasshopper\Libraries\Grafit\GraFit.dll", "C:\Users\fesmc\AppData\Roaming\Grasshopper\Libraries\Grafit\GraFitRhino.dll"])  # -> out, F1_CreateDualGraph, F2_CreatePrimalDirectedGraph, F3_GetShortestPath, F4_GetGeometry, F5_GetWeightMatrix, F6_FilterWeightMatrix, F7_CalculateCentralities
# ---------- c_functions: C# usings ----------
using Grafit;
using GrafitRhino;
using System.Linq;
# ---------- c_functions: C# ----------
    //delegate V MyDelegate<T,U,V>(T input, out U output);
    Func < List < Line>, bool, dynamic > f1 = f1_CreateDualGraph;
    Func < List < Line>, bool, dynamic > f2 = f2_CreatePrimalDirectedGraph;

    Func < object, int, int,  dynamic> f3 = f3_GetShortestPath;
    Func < object,  dynamic> f4 = f4_GetGeometry;
    Func < object,  dynamic> f5 = f5_GetWeightMatrix;
    Func < object, object, double, dynamic> f6 = f6_FilterWeightMatrix;
    Func < object, List < int>, List < int>, List < double>, bool, bool , dynamic> f7 = f7_CalculateCentralities; //object Graph, List<int> From, List<int> To, List<double> ODWeightMatrix, bool Directed

    F1_CreateDualGraph = f1;
    F2_CreatePrimalDirectedGraph = f2;
    F3_GetShortestPath = f3;
    F4_GetGeometry = f4;
    F5_GetWeightMatrix = f5;
    F6_FilterWeightMatrix = f6;
    F7_CalculateCentralities = f7;
# ---------- c_functions: C# additional code ----------
  //----------------------------------------------------------------------------------------------
  public static  dynamic  f1_CreateDualGraph(List<Line> LineGeometry, bool GPU)
  {

    CPrimalDirectedGraph<Point3d, Line> primalGraph;
    CDualUndirectedGraph<Point3d, Line> dualGraph;

    {
      double[] edgeLengths;

      var graphElements = GeometryToGraphElements<Point3d, Line>.GetNodesAndEdgesFromLines(LineGeometry.Select(s => new CWLine(s)),
        out edgeLengths);

      primalGraph = new CPrimalDirectedGraph<Point3d, Line>(graphElements);
      primalGraph.AddWeightMatrix(edgeLengths); // index 0
      primalGraph.AddEmptyWeightMatrix(); // index 1 - angles

      for(int i = 0; i < primalGraph.UndirectedEdges.Count; i++)
      {
        var n1 = primalGraph.UndirectedEdges[i][0];
        var n2 = primalGraph.UndirectedEdges[i][1];

        primalGraph.SetWeightMatrixValue(0.0, n1, n2, 1);
        primalGraph.SetWeightMatrixValue(0.0, n2, n1, 1);

      }
    }

    {
      double[] edgeLengths;
      double[] edgeAngles;

      var graphElements = GeometryToGraphElements<Point3d, Line>.GetDualNodesAndEdgesFromPrimalGraph(primalGraph,
        out edgeLengths, out edgeAngles);

      dualGraph = new CDualUndirectedGraph<Point3d, Line>(primalGraph, graphElements);

      dualGraph.AddWeightMatrix(edgeLengths); // index 0
      dualGraph.AddWeightMatrix(edgeAngles);  // index 1

      //dualGraph.APShortestPathsByManyWeights(0, 1, GPU);
      dualGraph.APShortestPathsByOneWeight(0, GPU);
    }


    return dualGraph;
  }

  //----------------------------------------------------------------------------------------------
  public static  dynamic f2_CreatePrimalDirectedGraph(List<Line> LineGeometry, bool GPU)
  {

    double[] edgeLengths;

    var graphElements = GeometryToGraphElements<Point3d, Line>.GetNodesAndEdgesFromLines(LineGeometry.Select(s => new CWLine(s)),
      out edgeLengths);



    var graph = new CPrimalDirectedGraph<Point3d, Line>(graphElements);
    graph.AddWeightMatrix(edgeLengths); // index 0
    graph.AddEmptyWeightMatrix(); // index 1

    for(int i = 0; i < graph.UndirectedEdges.Count; i++)
    {
      var n1 = graph.UndirectedEdges[i][0];
      var n2 = graph.UndirectedEdges[i][1];

      graph.SetWeightMatrixValue(1.0, n1, n2, 1);
      graph.SetWeightMatrixValue(1.0, n2, n1, 1);

    }

    //graph.APShortestPathsByManyWeights(0, 1, GPU);
    graph.APShortestPathsByOneWeight(0, GPU);

    return graph;
  }
  //----------------------------------------------------------------------------------------------
  public static  dynamic[] f3_GetShortestPath(object Graph, int Origin, int Destination)
  {
    var graph = Graph as AGraph;

    List <int> PathEdgesIds;
    List <int> PathNodesIds;


    //graph.GetShortestPathNodeIds(Origin, Destination, out PathNodesIds);
    bool isDirected = false;
    graph.GetShortestPathEdgeIds(Origin, Destination, isDirected, out PathNodesIds, out PathEdgesIds);

    var NodesPath = PathNodesIds;
    var EdgesPath = PathEdgesIds;


    var CostDistance = graph.GetShortestPathDistance(Origin, Destination, 0);
    var FilterDistance = graph.GetShortestPathDistance(Origin, Destination, 1);

    return new dynamic[4]  {NodesPath, EdgesPath, CostDistance, FilterDistance};

  }
  //----------------------------------------------------------------------------------------------
  public static dynamic[] f4_GetGeometry(object Graph)
  {
    var graph = Graph as ISpatialGraph<AWPoint<Point3d>, AWLine<Point3d, Line>, Point3d, Line>;

    if(Graph is CDualUndirectedGraph<Point3d, Line>)
    {
      var graph_dual = Graph as CDualUndirectedGraph<Point3d, Line>;
      graph = graph_dual.PrimalDirectedGraph;
    }

    var NodeAsPoints = graph.NodesGeometryList.Select(s => s.Internal);
    var EdgesDirected = graph.GenerateDirectedEdgeGeometry(CWLine.LineFromPoints).Select(s => s.Internal);
    var EdgesUndirected = graph.GenerateUndirectedEdgeGeometry(CWLine.LineFromPoints).Select(s => s.Internal);

    return new dynamic[3]  {NodeAsPoints, EdgesDirected, EdgesUndirected};
  }

  //----------------------------------------------------------------------------------------------
  public static dynamic f5_GetWeightMatrix(object Graph)
  {
    var graph = Graph as AGraph;
    var n = graph.NodesCount;

    if(Graph is CDualUndirectedGraph<Point3d, Line>)
    {
      var graph_dual = Graph as CDualUndirectedGraph<Point3d, Line>;
      n = graph_dual.PrimalDirectedGraph.NodesCount;
    }

    Matrix dmm = new Matrix(n, n);
    var dm = graph.GetWeigthMatrixById(0);

    for (int i = 0; i < n; i++)
    {
      for (int j = 0; j < n; j++)
      {
        dmm[i, j] = dm[i * n + j];
      }
    }

    return  dmm;

  }

  //----------------------------------------------------------------------------------------------
  public static dynamic f6_FilterWeightMatrix(object ODWeightMatrix, object Graph, double FilterValue)
  {
    var graph = Graph as AGraph;
    var n = graph.NodesCount;

    if(Graph is CDualUndirectedGraph<Point3d, Line>)
    {
      var graph_dual = Graph as CDualUndirectedGraph<Point3d, Line>;
      n = graph_dual.PrimalDirectedGraph.NodesCount;
    }

    var odwm = ODWeightMatrix as Rhino.Geometry.Matrix;
    var odwmAsArray = new double[n * n];

    for(int i = 0; i < n; i++)
      for(int j = 0; j < n; j++)
      {
        //if(odwm[i, j] <= FilterValue)
        odwmAsArray[i * n + j] = 1;//odwm[i, j];
      }


    return odwmAsArray;
  }

  public static dynamic[] f7_CalculateCentralities(object Graph, List<int> From, List<int> To, List<double> ODWeightMatrix, bool Directed, bool GPU = true)
  {
    var odwm = ODWeightMatrix; // as float[];
    var graph = Graph as IMeasurableGraph;
    var n = graph.NodesCountMeasure;

    var odwmAsArray = new double[n * n];

    for(int i = 0; i < n; i++)
      for(int j = 0; j < n; j++)
      {
        odwmAsArray[i * n + j] = odwm[i * n + j]; //0
      }

    //for(int i = 0; i < From.Count; i++)
    //  for(int j = 0; j < To.Count; j++)
    // {
    //odwmAsArray[From[i] * n + To[j]] = odwm[From[i] * n + To[j]];
    //  }


    var measurement = new CMeasure(graph);
    measurement.UseDirectedEdges = Directed;

    if(GPU)
      measurement.CalculateBCGPU(odwmAsArray); //only for Primal Directed Graph
    else
      measurement.CalculateBC(odwmAsArray);

    //here 0 is the filterMatrixId
    measurement.CalculateCC(odwmAsArray, 0);

    var BCN = measurement.BCNodes;
    var BCE = measurement.BCEdges;

    var CCN = measurement.CCNodes;
    var CCE = measurement.CCEdges;

    return new dynamic[4]  {BCN, BCE, CCN, CCE};

  }
# ---------- end c_functions ----------
crv_3 = Curve([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])
crv_4 = Curve([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])
crv_5 = Curve([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])
explode = Explode(Curve=crv_2, Recursive=True)  # -> flatten(Segments), Vertices
line = Line(flatten(explode.Segments))
toggle = BooleanToggle(False)
c_f1_dual_graph = CSharpScript(LineGeometry=line, GPU=toggle, f=c_functions.F1_CreateDualGraph)  # -> out, DualGraph; inputs LineGeometry: list of Line, GPU: Boolean
# ---------- c_f1_dual_graph: C# usings ----------
 
using System.Linq;
# ---------- c_f1_dual_graph: C# ----------
    var F = f as  Func<List<Line>, bool, dynamic >;

    DualGraph = F(LineGeometry, GPU);

    return;
# ---------- end c_f1_dual_graph ----------
c_f2_primal_directed_graph = CSharpScript(LineGeometry=line, GPU=toggle, f=c_functions.F2_CreatePrimalDirectedGraph)  # -> out, PrimalDirGraph; inputs LineGeometry: list of Line, GPU: Boolean
# ---------- c_f2_primal_directed_graph: C# usings ----------
using System.Linq;
# ---------- c_f2_primal_directed_graph: C# ----------
    var F = f as  Func<List<Line>, bool, dynamic >;

    PrimalDirGraph = F(LineGeometry, GPU);

    return;
# ---------- end c_f2_primal_directed_graph ----------
agraph = Data(c_f2_primal_directed_graph.PrimalDirGraph)
c_f4_generate_geometry = CSharpScript(Graph=agraph, f=c_functions.F4_GetGeometry)  # -> out, NodeAsPoints, EdgesDirected, EdgesUndirected
# ---------- c_f4_generate_geometry: C# usings ----------
//using Grafit;
//using GrafitRhino;
using System.Linq;
# ---------- c_f4_generate_geometry: C# ----------
    var F = f as   Func<object, dynamic>;

    var result = F(Graph); 

    NodeAsPoints = result[0];
    EdgesDirected = result[1];
    EdgesUndirected = result[2];

    return;

    /*
    var graph = Graph as ISpatialGraph<AWPoint<Point3d>, AWLine<Point3d, Line>, Point3d, Line>;

    if(Graph is CDualUndirectedGraph<Point3d, Line>)
    {
      var graph_dual = Graph as CDualUndirectedGraph<Point3d, Line>;
      graph = graph_dual.PrimalDirectedGraph;
    }

    NodeAsPoints = graph.NodesGeometryList.Select(s => s.Internal);
    EdgesDirected = graph.GenerateDirectedEdgeGeometry(CWLine.LineFromPoints).Select(s => s.Internal);
    EdgesUndirected = graph.GenerateUndirectedEdgeGeometry(CWLine.LineFromPoints).Select(s => s.Internal);
 */
# ---------- c_f4_generate_geometry: C# additional code ----------
  public delegate TResult CFunc<in T1, T2, T3, T4, out TResult>(T1 input, out T2 output1, out T3 output2, out T4 output3);
# ---------- end c_f4_generate_geometry ----------
c_f5_get_distance_matrix = CSharpScript(Graph=agraph, f=c_functions.F5_GetWeightMatrix)  # -> out, DistanceMatrix
# ---------- c_f5_get_distance_matrix: C# ----------
    var F = f as   Func<object,  dynamic>;

    var result = F(Graph);

    DistanceMatrix = result;

    return;

    /*var graph = Graph as AGraph;
    var n = graph.NodesCount;

    if(Graph is CDualUndirectedGraph<Point3d, Line>)
    {
      var graph_dual = Graph as CDualUndirectedGraph<Point3d, Line>;
      n = graph_dual.PrimalDirectedGraph.NodesCount;
    }

    Matrix dmm = new Matrix(n, n);
    var dm = graph.GetWeigthMatrixById(0);
    // or graph.GetPointToPointCostDistanceMatrix();
    // or graph.GetPointToPointFilterDistanceMatrix(0); //input index

    for (int i = 0; i < n; i++)
    {
      for (int j = 0; j < n; j++)
      {
        dmm[i, j] = dm[i * n + j];
      }
    }

    DistanceMatrix = dmm;*/
# ---------- end c_f5_get_distance_matrix ----------
edgeundirectedlines = Data(c_f4_generate_geometry.EdgesUndirected)
edgedirectedlines = Data(c_f4_generate_geometry.EdgesDirected)
nodepoints = Data(c_f4_generate_geometry.NodeAsPoints)
c_f6_filter_distance_matrix = CSharpScript(
    ODWeightMatrix=c_f5_get_distance_matrix.DistanceMatrix,
    Graph=agraph,
    FilterValue="100",
    f=c_functions.F6_FilterWeightMatrix)  # -> out, ODWeightMatrixFiltered; inputs FilterValue: Double
# ---------- c_f6_filter_distance_matrix: C# ----------
    var F = f as   Func<object, object, double, dynamic>;

    var result = F(ODWeightMatrix, Graph, FilterValue);

    ODWeightMatrixFiltered = result;

    return;

    /*var graph = Graph as AGraph;
    var n = graph.NodesCount;

    if(Graph is CDualUndirectedGraph<Point3d, Line>)
    {
      var graph_dual = Graph as CDualUndirectedGraph<Point3d, Line>;
      n = graph_dual.PrimalDirectedGraph.NodesCount;
    }

    var odwm = ODWeightMatrix as Rhino.Geometry.Matrix;
    var odwmAsArray = new double[n * n];

    for(int i = 0; i < n; i++)
      for(int j = 0; j < n; j++)
      {
        //if(odwm[i, j] <= FilterValue)
        odwmAsArray[i * n + j] = 1;//odwm[i, j];
      }


    ODWeightMatrixFiltered = odwmAsArray;
 */
# ---------- end c_f6_filter_distance_matrix ----------
panel = Panel("""10
9
11
26
22""")
panel_2 = Panel("""0
19
1""")
toggle_2 = BooleanToggle(False)
destination = Point(Point(35.0216247, 63.01015667, 0))
origin = Point(Point(-23.9204757, 48.42530156, 0))
cp = ClosestPoint(Point=origin, Cloud=nodepoints)  # -> ClosestPoint, CPIndex, Distance
cp_2 = ClosestPoint(Point=destination, Cloud=nodepoints)  # -> ClosestPoint, CPIndex, Distance
c_f3_get_shortest_paths = CSharpScript(Graph=agraph, Origin=cp.CPIndex, Destination=cp_2.CPIndex, f=c_functions.F3_GetShortestPath)  # -> out, NodesPath, EdgesPath, CostDistance, FilterDistance; inputs Origin: Int32, Destination: Int32
# ---------- c_f3_get_shortest_paths: C# ----------
    var F = f as   Func<object, int, int, dynamic>;

    var result = F(Graph, Origin, Destination);

    NodesPath = result[0];
    EdgesPath = result[1];
    CostDistance = result[2];
    FilterDistance = result[3];

    return;


   /* var graph = Graph as AGraph;

    List <int> PathEdgesIds;
    List <int> PathNodesIds;


    //graph.GetShortestPathNodeIds(Origin, Destination, out PathNodesIds);
    graph.GetShortestPathEdgeIds(Origin, Destination, out PathNodesIds, out PathEdgesIds);

    NodesPath = PathNodesIds;
    EdgesPath = PathEdgesIds;


    CostDistance = graph.GetShortestPathDistance(Origin, Destination, 0);
    FilterDistance = graph.GetShortestPathDistance(Origin, Destination, 1);
*/
# ---------- end c_f3_get_shortest_paths ----------
c_f7_calculate_bc_and_cc = CSharpScript(
    Graph=agraph,
    From=panel_2,
    To=panel,
    ODWeightMatrix=c_f6_filter_distance_matrix.ODWeightMatrixFiltered,
    Directed=toggle_2,
    f=c_functions.F7_CalculateCentralities,
    GPU=Toggle(True))  # -> out, BCN, BCE, CCN, CCE; inputs From: list of Int32, To: list of Int32, ODWeightMatrix: list of Double, Directed: Boolean, GPU: Boolean
# ---------- c_f7_calculate_bc_and_cc: C# ----------
    var F = f as   Func < object, List < int>, List < int>, List < double>, bool, bool, dynamic>;

    var result = F(Graph, From, To, ODWeightMatrix, Directed, GPU);

    BCN = result[0];
    BCE = result[1];

    CCN = result[2];
    CCE = result[3];

    return;

    /*
    var odwm = ODWeightMatrix; // as float[];
    var graph = Graph as IMeasurableGraph;
    var n = graph.NodesCountMeasure;

    var odwmAsArray = new double[n * n];

    for(int i = 0; i < n; i++)
      for(int j = 0; j < n; j++)
      {
        odwmAsArray[i * n + j] = odwm[i * n + j]; //0
      }

    for(int i = 0; i < From.Count; i++)
      for(int j = 0; j < To.Count; j++)
      {
        //odwmAsArray[From[i] * n + To[j]] = odwm[From[i] * n + To[j]];
      }


    var measurement = new CMeasure(graph);
    measurement.UseDirectedEdges = Directed;

    measurement.CalculateBC(odwmAsArray);

    //here 0 is the filterMatrixId
    measurement.CalculateCC(odwmAsArray, 0);

    BCN = measurement.BCNodes;
    BCE = measurement.BCEdges;

    CCN = measurement.CCNodes;
    CCE = measurement.CCEdges;

 */
# ---------- end c_f7_calculate_bc_and_cc ----------
panel_3 = Panel(c_f7_calculate_bc_and_cc.BCN)
c_script = CSharpScript(lines=edgeundirectedlines)  # -> out, A; inputs lines: list of Line
# ---------- c_script: C# ----------
    var translatedLines = new Line[lines.Count * 2];
    int index = 0;
    double distance = 0.05;
 
    foreach (Line line in lines)
    {
      Point3d midpoint = line.PointAt(0.5);
      Vector3d tangent = line.UnitTangent;
      Vector3d normal = Vector3d.CrossProduct(tangent, Vector3d.ZAxis);
      normal *= distance;
      Point3d start = line.From + normal;
      Point3d end = line.To + normal;
      Line translatedLine = new Line(start, end); 

      translatedLines[index] = new Line(start, end);
      index++;
    }

    foreach (Line line in lines)
    {
      line.Flip();
      Point3d midpoint = line.PointAt(0.5);
      Vector3d tangent = line.UnitTangent;
      Vector3d normal = Vector3d.CrossProduct(tangent, Vector3d.ZAxis);
      normal *= distance;
      Point3d start = line.From + normal;
      Point3d end = line.To + normal;
      Line translatedLine = new Line(start, end); 

      translatedLines[index] = new Line(start, end);
      index++;
    }


    A = translatedLines;
# ---------- end c_script ----------
filter = StreamFilter(Gate=toggle_2, Stream0=edgeundirectedlines, Stream1=c_script.A)

# ---- group: Edges
values_num_edges = Number(c_f7_calculate_bc_and_cc.BCE)
lines_crv = Curve(filter)
log = Logarithm(Value=values_num_edges)
bnd = Bounds(Numbers=log)
remap = RemapNumbers(Value=log, Source=bnd, Target=Domain(0, 1))  # -> Mapped, Clipped
gradient = Gradient(
    LowerLimit=0,
    UpperLimit=1,
    Parameter=remap.Mapped,
    stops=[0: RGB(0, 0, 139), 0.221: RGB(50, 178, 206), 0.709: RGB(255, 215, 0), 1: RGB(255, 0, 0)])
previewlw = CustomPreviewLineweights(Geometry=lines_crv, Shader=gradient, Thickness=Slider(5, range=0..10), Absolute=False)

# ---- group: Nodes
values_num_nodes = Number(c_f7_calculate_bc_and_cc.BCN)
log_2 = Logarithm(Value=values_num_nodes)
bnd_2 = Bounds(Numbers=log_2)
remap_2 = RemapNumbers(Value=log_2, Source=bnd_2, Target=Domain(0, 1))  # -> Mapped, Clipped
gradient_2 = Gradient(
    LowerLimit=0,
    UpperLimit=1,
    Parameter=remap_2.Mapped,
    stops=[0: RGB(0, 0, 139), 0.221: RGB(50, 178, 206), 0.709: RGB(255, 215, 0), 1: RGB(255, 0, 0)])
symsim = SymbolSimple(Style=5, Size=Slider(6, range=0..10), Rotation=0, Colour=gradient_2)
symbol = SymbolDisplay(Location=nodepoints, Display=symsim)

# ----
panel_4 = Panel([c_f3_get_shortest_paths.CostDistance, c_f3_get_shortest_paths.FilterDistance])

# ---- group: Get vec Path
item = ListItem(List=edgedirectedlines, Index="0", Wrap=True)
explode_2 = Explode(Curve=item, Recursive=True)  # -> Segments, Vertices
item_2 = ListItem(List=explode_2.Vertices, Index=0, Wrap=True)  # -> Item, Item1
vec2pt = Vector2Pt(PointA=item_2.Item, PointB=item_2.Item1, Unitize=False)  # -> Vector, Length
vdis = VectorDisplay(Anchor=item_2.Item, Vector=vec2pt.Vector)

# ----
matrix = DisplayMatrix(c_f5_get_distance_matrix.DistanceMatrix)  # disabled

# ---- group: Dual
pointspath = Data(c_f3_get_shortest_paths.NodesPath)
linespath = Data(c_f3_get_shortest_paths.EdgesPath)
swatch = ColourSwatch(SwatchColor=RGB(84, 199, 116))
item_3 = ListItem(List=edgedirectedlines, Index=linespath, Wrap=True)
item_4 = ListItem(List=nodepoints, Index=pointspath, Wrap=True)
symsim_2 = SymbolSimple(Style=7, Size=12, Rotation=0, Colour=swatch)
symbol_2 = SymbolDisplay(Location=item_4, Display=symsim_2)
previewlw_2 = CustomPreviewLineweights(Geometry=item_3, Shader=swatch, Thickness=Slider(5, range=0..10), Absolute=False)

# ---- group: Get vec Path
explode_3 = Explode(Curve=c_script.A, Recursive=True)  # -> Segments, Vertices
item_5 = ListItem(List=explode_3.Vertices, Index=0, Wrap=True)  # -> Item, Item1
vec2pt_2 = Vector2Pt(PointA=item_5.Item, PointB=item_5.Item1, Unitize=False)  # -> Vector, Length
vdis_2 = VectorDisplay(Anchor=item_5.Item, Vector=vec2pt_2.Vector)

# ---- group: Visualisation
eval = EvaluateCurve(Curve=c_script.A, Parameter=Slider(0.5, range=0..1))  # -> Point, Tangent, Angle
points = PointList(Points=nodepoints)
points_2 = PointList(Points=eval.Point)

# ---- group: vector path
item_6 = ListItem(List=edgedirectedlines, Index=linespath, Wrap=True)
end = EndPoints(Curve=item_6)  # -> Start, End
vdis_3 = VectorDisplay(Anchor=end.Start, Vector=item_6)
