# Grasshopper definition GraFit Network Python Cluster Example.gh (Grasshopper 1.0.7)
# plug-ins: Human

# ---- group: Test Network Geometry
crv_random_network_s = Curve([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])
crv_random_network_l = Curve([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])
crv_regular_grid = Curve([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])

# ---- group: Get Path to Grafit
# Thsi script searches Grafit.dll in default Grasshopper lib folder
grafitpath = Panel("C:/Users/<User>/AppData/Roaming/Grasshopper/Libraries/Grafit/Grafit.dll")
grafitrhinopath = Panel("C:/Users/<User>/AppData/Roaming/Grasshopper/Libraries/Grafit/GrafitRhino.dll")
pythonsrcpath = Panel("C:/Users/<User>/AppData/Roaming/Grasshopper/Libraries/Grafit/examples/rhino/")
c_auto_search = CSharpScript()  # -> out, GrafitPath, GrafitRhinoPath, PythonSrcPath; same code as c_auto_search

# ----
explode = Explode(Curve=crv_random_network_l, Recursive=True)  # -> flatten(Segments), Vertices
line = Line(flatten(explode.Segments))
# For example, set all additional edge weights as 1. Shortest path then will reflect number of segments in path. This weights are stored as WeightMatrix with index #1
lng = ListLength(List=line)
toggle_calculateallmatrices = BooleanToggle(False)
panel = Panel("""0.5
0.1""")
toggle_usefiltermatrix = BooleanToggle(False)
repeat = RepeatData(Data=" 1", Length=lng)
toggle_gpu = BooleanToggle(True)
weight_matrix_id = Panel("1")
weight_filter_matrix_id = Panel("0")
data = Data(repeat)
cluster_python_f14_dual_graph_cognitive = ClusterPythonF14DualGraphCognitiveDistance(
    pythonsrcfolderpath=c_auto_search.PythonSrcPath,
    libpathgrafit=c_auto_search.GrafitPath,
    libpathgrafitrhino=c_auto_search.GrafitRhinoPath)  # "Cluster Python F14 Dual Graph Cognitive Distance"; disabled
cluster_python_f1_dual_graph = ClusterPythonF1DualGraph(
    pythonsrcfolderpath=c_auto_search.PythonSrcPath,
    libpathgrafit=c_auto_search.GrafitPath,
    libpathgrafitrhino=c_auto_search.GrafitRhinoPath,
    linegeometry=line,
    weightmatrixindexmain=weight_matrix_id,
    weightmatrixindexfilter=weight_filter_matrix_id,
    calculateallmatrices=toggle_calculateallmatrices,
    usefiltermatrix=toggle_usefiltermatrix,
    gpu=toggle_gpu)
cluster_python_f2_primal_directed_graph = ClusterPythonF2PrimalDirectedGraph(
    pythonsrcfolderpath=c_auto_search.PythonSrcPath,
    linegeometry=line,
    edgeweightsforward=data,
    edgeweightsbackward=data,
    weightmatrixindexmain=weight_matrix_id,
    weightmatrixindexfilter=weight_filter_matrix_id,
    calculateallmatrices=toggle_calculateallmatrices,
    usefiltermatrix=toggle_usefiltermatrix,
    gpu=toggle_gpu)
brep_obstacles = Brep(flatten([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]))
srf_ground = Surface(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)
origin_ids = Panel("""0
1
6
11""")
destination_ids = Panel("""3
5
7
34""")
agraph = Data(cluster_python_f2_primal_directed_graph)
vertical_angle_offset = Slider(0, range=0..100)
horizontal_precision = Slider(10, range=0..10)
vertical_precision = Slider(10, range=0..10)
toggle_out_hit_points = BooleanToggle(False)
mesh = MeshBrep(
    Brep=brep_obstacles,
    Settings={GridMaxCount=0, GridMinCount=16, JaggedSeams=False, MaxEdgeLength=0, MinEdgeLength=0.0001, MinTolerance=0, Refine=True, RefineAngle=0, RelativeTolerance=0.65, SimplePlanes=True, Tolerance=0})
mesh_2 = MeshBrep(
    Brep=srf_ground,
    Settings={GridMaxCount=0, GridMinCount=16, JaggedSeams=False, MaxEdgeLength=0, MinEdgeLength=0.0001, MinTolerance=0, Refine=True, RefineAngle=0, RelativeTolerance=0.65, SimplePlanes=True, Tolerance=0})
cluster = ClusterPythonF10DisconnectedParts(graph=agraph)
cluster_python_f5_get_weight_matrix_as_m = ClusterPythonF5GetWeightMatrixAsMatrix(
    pythonsrcfolderpath=c_auto_search.PythonSrcPath,
    libpathgrafit=c_auto_search.GrafitPath,
    libpathgrafitrhino=c_auto_search.GrafitRhinoPath,
    graph=agraph,
    from=origin_ids,
    to=destination_ids,
    weightmatrixindex=weight_matrix_id)  # "Cluster Python F5 Get Weight Matrix As Matrix"
cluster_python_f4_generate_geometry = ClusterPythonF4GenerateGeometry(
    pythonsrcfolderpath=c_auto_search.PythonSrcPath,
    libpathgrafit=c_auto_search.GrafitPath,
    libpathgrafitrhino=c_auto_search.GrafitRhinoPath,
    graph=agraph)  # -> nodeaspoints, edgesdirected, edgesundirected
cluster_python_f10_disconnectedparts = ClusterPythonF10DisconnectedParts(
    pythonsrcfolderpath=c_auto_search.PythonSrcPath,
    libpathgrafit=c_auto_search.GrafitPath,
    libpathgrafitrhino=c_auto_search.GrafitRhinoPath,
    graph=agraph)  # disabled
edgeundirectedlines = Data(cluster_python_f4_generate_geometry.edgesundirected)
undiredges = Line(edgeundirectedlines)
# Each edge here have 2 points. This tree structure is converted to a flat list of points and to a tree where each edge index corresponds to flat point index
eval = EvaluateCurve(Curve=graft(undiredges), Parameter=panel)  # -> Point, Tangent, Angle
move = Move(Geometry=eval.Point, Motion="{0, 0, 1}")  # -> simplify(Geometry), Transform
c_create_vp_per_edge_tree = CSharpScript(GeometryTree=move.Geometry)  # -> out, FlatPointsList, IndexTree; inputs GeometryTree: tree of Point3d
# ---------- c_create_vp_per_edge_tree: C# ----------
    var resultIndex = new DataTree<int>();
    var resultPoints = new List<Point3d>();

    int flatIndex = 0;

    for(int i = 0; i < GeometryTree.BranchCount; i++)
    {
      foreach(var item in GeometryTree.Branches[i])
      {
        resultIndex.Add(flatIndex, new GH_Path(i));
        resultPoints.Add(item);
        flatIndex++;
      }
    }

    FlatPointsList = resultPoints;
    IndexTree = resultIndex;
# ---------- end c_create_vp_per_edge_tree ----------
vantagepoints = Point(c_create_vp_per_edge_tree.FlatPointsList)

vec = VectorXYZ(XComponent=0, YComponent="-1", ZComponent=0)  # -> Vector, Length
lng_2 = ListLength(List=vantagepoints)
repeat_2 = RepeatData(Data=vec.Vector, Length=lng_2)

cluster_python_f13_isovist_3d_gpu = ClusterPythonF13Isovist3DGPU(
    pythonsrcfolderpath=c_auto_search.PythonSrcPath,
    libpathgrafit=c_auto_search.GrafitPath,
    libpathgrafitrhino=c_auto_search.GrafitRhinoPath,
    vp=vantagepoints,
    os=mesh,
    gs=mesh_2,
    vd=repeat_2,
    vr=Slider(1000, range=0..1000),
    hva=Slider(360, range=0..1000),
    vva=Slider(90, range=0..100),
    hpr=horizontal_precision,
    vpr=vertical_precision,
    vao=vertical_angle_offset,
    ohp=toggle_out_hit_points)  # -> hitpoints, flatten(meshidsperray), numberofrays
edgedirectedlines = Data(cluster_python_f4_generate_geometry.edgesdirected)
nodepoints = Data(cluster_python_f4_generate_geometry.nodeaspoints)
stop_searching_at_this_number_of_paths = Panel("800")

# ---- group: Get Rays for Vantage Point
vantage_point_id = Panel("5")
c_script = CSharpScript(
    VPID=vantage_point_id,
    RaysCountPerPoint=cluster_python_f13_isovist_3d_gpu.numberofrays,
    HitPoints=cluster_python_f13_isovist_3d_gpu.hitpoints)  # -> out, A; inputs VPID: Int32, RaysCountPerPoint: Int32, HitPoints: list
# ---------- c_script: C# ----------
    if(HitPoints == null || HitPoints.Count == 0 || HitPoints[0] == null)
      return;

    var resultIds = new List<Point3d>();

    for(int i = 0; i < RaysCountPerPoint; i++)
    {
      var pointObj = HitPoints[VPID * RaysCountPerPoint + i] as dynamic;
      resultIds.Add(new Point3d(pointObj.x, pointObj.y, pointObj.z));
    } 


    A =  resultIds;
# ---------- end c_script ----------
item = ListItem(List=vantagepoints, Index=vantage_point_id, Wrap=True)
ln = Line(StartPoint=item, EndPoint=c_script.A)

# ----
destination = Point(Point(11.3919731, 64.68040582, 0))
origin = Point(Point(-37.08688782, 11.53385668, 0))
panel_2 = Panel("""0
1""")
panel_3 = Panel("""3.001
90.001""")
cp = ClosestPoint(Point=destination, Cloud=nodepoints)  # -> ClosestPoint, CPIndex, Distance
# Shortest Path
cp_2 = ClosestPoint(Point=origin, Cloud=nodepoints)  # -> ClosestPoint, CPIndex, Distance
toggle_directed = BooleanToggle(False)
toggle_gpu_2 = BooleanToggle(True)

# ---- group: Offset line geometry to visualise both directions
# Centralities
c_script_2 = CSharpScript(lines=edgeundirectedlines)  # -> out, A; inputs lines: list of Line
# ---------- c_script_2: C# usings ----------
using System.Linq;
# ---------- c_script_2: C# ----------
    var translatedLines = new Line[lines.Count * 2];
    int index = 0;
    double distance = 0.05;
 
    foreach (Line line in lines)
    {
      Point3d midpoint = line.PointAt(0.5);
      Vector3d tangent = line.UnitTangent;
      Vector3d normal = Vector3d.CrossProduct(tangent, Vector3d.ZAxis);
      normal *= distance;
      Point3d start = line.From + normal;
      Point3d end = line.To + normal;
      Line translatedLine = new Line(start, end); 

      translatedLines[index] = new Line(start, end);
      index++;
    }

    foreach (Line line in lines)
    {
      line.Flip();
      Point3d midpoint = line.PointAt(0.5);
      Vector3d tangent = line.UnitTangent;
      Vector3d normal = Vector3d.CrossProduct(tangent, Vector3d.ZAxis);
      normal *= distance;
      Point3d start = line.From + normal;
      Point3d end = line.To + normal;
      Line translatedLine = new Line(start, end); 

      translatedLines[index] = new Line(start, end);
      index++;
    }


    A = translatedLines;
# ---------- end c_script_2 ----------
filter = StreamFilter(Gate=toggle_directed, Stream0=edgeundirectedlines, Stream1=c_script_2.A)

# ----
# Isovist / Visibility along path
toggle_directed_2 = BooleanToggle(True)
cluster_python_f11_get_alternative_paths = ClusterPythonF11GetAlternativePaths(
    pythonsrcfolderpath=c_auto_search.PythonSrcPath,
    libpathgrafit=c_auto_search.GrafitPath,
    libpathgrafitrhino=c_auto_search.GrafitRhinoPath,
    graph=agraph,
    origin=cp_2.CPIndex,
    destination=cp.CPIndex,
    weightids=panel_2,
    weighttolerance=panel_3,
    limit=stop_searching_at_this_number_of_paths)  # -> nodespath, edgespath; disabled
cluster_python_f3_get_shortest_paths = ClusterPythonF3GetShortestPaths(
    pythonsrcfolderpath=c_auto_search.PythonSrcPath,
    libpathgrafit=c_auto_search.GrafitPath,
    libpathgrafitrhino=c_auto_search.GrafitRhinoPath,
    graph=agraph,
    origin=cp_2.CPIndex,
    destination=cp.CPIndex,
    usedirectededges=Toggle(True))  # -> nodespath, edgespath, distances
lng_3 = ListLength(List=mesh)
cluster_python_f7_calculate_bc_and_cc = ClusterPythonF7CalculateBCAndCC(
    pythonsrcfolderpath=c_auto_search.PythonSrcPath,
    libpathgrafit=c_auto_search.GrafitPath,
    libpathgrafitrhino=c_auto_search.GrafitRhinoPath,
    graph=agraph,
    from=origin_ids,
    to=destination_ids,
    odweightmatrixreduced=cluster_python_f5_get_weight_matrix_as_m,
    usedirectededges=toggle_directed,
    calculatebc=Toggle(True),
    calculatecc=Toggle(True),
    ccweightmatrixid=weight_matrix_id,
    gpu=toggle_gpu_2)  # -> bcn, bce, ccn, cce
cluster_python_f12_calculate_path_visibi = ClusterPythonF12CalculatePathVisibility(
    pythonsrcfolderpath=c_auto_search.PythonSrcPath,
    libpathgrafit=c_auto_search.GrafitPath,
    libpathgrafitrhino=c_auto_search.GrafitRhinoPath,
    graph=agraph,
    from=origin_ids,
    to=destination_ids,
    odweightmatrixreduced=cluster_python_f5_get_weight_matrix_as_m,
    directed=toggle_directed_2,
    meshidsperray=cluster_python_f13_isovist_3d_gpu.meshidsperray,
    edgetovantagepoints=c_create_vp_per_edge_tree.IndexTree,
    brepscount=lng_3)  # "Cluster Python F12 Calculate Path Visibility"

# ---- group: Visibility
values = Number(cluster_python_f12_calculate_path_visibi)
log = Logarithm(Value=values)
bnd = Bounds(Numbers=log)
remap = RemapNumbers(Value=log, Source=bnd, Target=Domain(0, 1))  # -> Mapped, Clipped
gradient = Gradient(
    LowerLimit=0,
    UpperLimit=1,
    Parameter=remap.Mapped,
    stops=[0: RGB(0, 0, 139), 0.221: RGB(50, 178, 206), 0.709: RGB(255, 215, 0), 1: RGB(255, 0, 0)])
preview = CustomPreview(Geometry=brep_obstacles, Material=gradient)

# ---- group: Edges
values_num_edges = Number(cluster_python_f7_calculate_bc_and_cc.bce)
log_2 = Logarithm(Value=values_num_edges)
bnd_2 = Bounds(Numbers=log_2)
remap_2 = RemapNumbers(Value=log_2, Source=bnd_2, Target=Domain(0, 1))  # -> Mapped, Clipped
gradient_2 = Gradient(
    LowerLimit=0,
    UpperLimit=1,
    Parameter=remap_2.Mapped,
    stops=[0: RGB(0, 0, 139), 0.221: RGB(50, 178, 206), 0.709: RGB(255, 215, 0), 1: RGB(255, 0, 0)])
lines_crv = Curve(filter)
previewlw = CustomPreviewLineweights(Geometry=lines_crv, Shader=gradient_2, Thickness=Slider(5, range=0..10), Absolute=False)

# ---- group: Nodes
values_num_nodes = Number(cluster_python_f7_calculate_bc_and_cc.bcn)
log_3 = Logarithm(Value=values_num_nodes)
bnd_3 = Bounds(Numbers=log_3)
remap_3 = RemapNumbers(Value=log_3, Source=bnd_3, Target=Domain(0, 1))  # -> Mapped, Clipped
gradient_3 = Gradient(
    LowerLimit=0,
    UpperLimit=1,
    Parameter=remap_3.Mapped,
    stops=[0: RGB(0, 0, 139), 0.221: RGB(50, 178, 206), 0.709: RGB(255, 215, 0), 1: RGB(255, 0, 0)])
symsim = SymbolSimple(Style=5, Size=Slider(6, range=0..10), Rotation=0, Colour=gradient_3)
symbol = SymbolDisplay(Location=nodepoints, Display=symsim)

# ----
nodespathalternative = Data(cluster_python_f11_get_alternative_paths.nodespath)
edgespathalternative = Data(cluster_python_f11_get_alternative_paths.edgespath)
nodespath = Data(cluster_python_f3_get_shortest_paths.nodespath)
edgespath = Data(cluster_python_f3_get_shortest_paths.edgespath)

# ---- group: Get vec Path
item_2 = ListItem(List=edgedirectedlines, Index="0", Wrap=True)
explode_2 = Explode(Curve=item_2, Recursive=True)  # -> Segments, Vertices
item_3 = ListItem(List=explode_2.Vertices, Index=0, Wrap=True)  # -> Item, Item1
vec2pt = Vector2Pt(PointA=item_3.Item, PointB=item_3.Item1, Unitize=False)  # -> Vector, Length
vdis = VectorDisplay(Anchor=item_3.Item, Vector=vec2pt.Vector)

# ---- group: Shortest Path Visualisation
pointspath = Data(nodespath)
linespath = Data(edgespath)
swatch = ColourSwatch(SwatchColor=RGB(84, 199, 116))
item_4 = ListItem(List=nodepoints, Index=pointspath, Wrap=True)
item_5 = ListItem(List=edgedirectedlines, Index=linespath, Wrap=True)
symsim_2 = SymbolSimple(Style=7, Size=12, Rotation=0, Colour=swatch)
symbol_2 = SymbolDisplay(Location=item_4, Display=symsim_2)
previewlw_2 = CustomPreviewLineweights(Geometry=item_5, Shader=swatch, Thickness=Slider(5, range=0..10), Absolute=False)

# ---- group: Get vec Path
explode_3 = Explode(Curve=c_script_2.A, Recursive=True)  # -> Segments, Vertices
item_6 = ListItem(List=explode_3.Vertices, Index=0, Wrap=True)  # -> Item, Item1
vec2pt_2 = Vector2Pt(PointA=item_6.Item, PointB=item_6.Item1, Unitize=False)  # -> Vector, Length
vdis_2 = VectorDisplay(Anchor=item_6.Item, Vector=vec2pt_2.Vector)

# ---- group: Visualisation
eval_2 = EvaluateCurve(Curve=c_script_2.A, Parameter=Slider(0.5, range=0..1))  # -> Point, Tangent, Angle
points = PointList(Points=eval_2.Point, Size=Slider(0.07, range=0..1.1))
points_2 = PointList(Points=nodepoints, Size=Slider(0.3, range=0..1))

# ---- group: vector path
item_7 = ListItem(List=edgedirectedlines, Index=linespath, Wrap=True)
end = EndPoints(Curve=item_7)  # -> Start, End
vdis_3 = VectorDisplay(Anchor=end.Start, Vector=item_7)

# ==== cluster ClusterPythonF1DualGraph
panel = Panel("Python F1 Dual Graph.py")
pythonsrcfolderpath = ClusterInput()  # PythonSrcFolderPath
c_auto_search = CSharpScript()  # -> out, GrafitPath, GrafitRhinoPath, PythonSrcPath
# ---------- c_auto_search: C# usings ----------
using System.IO;
# ---------- c_auto_search: C# ----------
    // Get the default library folder path
    //@"%Appdata%\Grasshopper\Libraries\";
    string appDataPath = Environment.GetFolderPath(Environment.SpecialFolder.ApplicationData);
    string searchDirectory = Path.Combine(appDataPath, @"Grasshopper\Libraries\"); // Replace with the subfolder you want to search in


    var searchResult = Directory.GetFiles(searchDirectory, "Grafit.dll", SearchOption.AllDirectories);

    if(searchResult.Length == 0)
      throw new Exception("Grafit.dll is not found in Grasshopper/Libraries folder.");

    string dllFile = searchResult[0];
    string directoryPath = Path.GetDirectoryName(dllFile) + @"\";

    GrafitPath = directoryPath + "Grafit.dll";
    GrafitRhinoPath = directoryPath + "GrafitRhino.dll";


    string[] exampleDirectory = Directory.GetDirectories(searchDirectory, "examples", SearchOption.AllDirectories);



    PythonSrcPath = exampleDirectory[0] + @"\rhino\";//directoryPath + @"examples\rhino\";
# ---------- end c_auto_search ----------
concat = Concatenate(FragmentA=pythonsrcfolderpath, FragmentB=panel)
c_script = CSharpScript(file=panel, pythonScrFolderPaht=pythonsrcfolderpath, userString=concat, autoString=c_auto_search.PythonSrcPath)  # -> out, Code; inputs file: String, userString: String, autoString: String
# ---------- c_script: C# ----------
    if (pythonScrFolderPaht != null)
      Code = userString;
    else
      Code = autoString + file;
# ---------- end c_script ----------
weightmatrixindexmain = ClusterInput()
weightmatrixindexfilter = ClusterInput()
calculateallmatrices = ClusterInput()
libpathgrafitrhino = ClusterInput()
usefiltermatrix = ClusterInput()
linegeometry = ClusterInput()
libpathgrafit = ClusterInput()
gpu = ClusterInput()
python_f1_dual_graph = GhPythonScript(
    Code=c_script.Code,
    LibPathGrafit=libpathgrafit,
    LibPathGrafitRhino=libpathgrafitrhino,
    LineGeometry=linegeometry,
    WeightMatrixIndexMain=weightmatrixindexmain,
    WeightMatrixIndexFilter=weightmatrixindexfilter,
    CalculateAllMatrices=calculateallmatrices,
    UseFilterMatrix=usefiltermatrix,
    GPU=gpu)  # -> Out, DualGraph
dualgraph = ClusterOutput(python_f1_dual_graph.DualGraph)

# ==== cluster ClusterPythonF14DualGraphCognitiveDistance
panel = Panel("Python F14 Dual Graph Cognitive Distance.py")
c_auto_search = CSharpScript()  # -> out, GrafitPath, GrafitRhinoPath, PythonSrcPath; same code as c_auto_search
pythonsrcfolderpath = ClusterInput()  # PythonSrcFolderPath
edgesisactivitynodelinkundir = ClusterInput()
concat = Concatenate(FragmentA=pythonsrcfolderpath, FragmentB=panel)
c_script = CSharpScript(file=panel, pythonScrFolderPaht=pythonsrcfolderpath, userString=concat, autoString=c_auto_search.PythonSrcPath)  # -> out, Code; inputs file: String, userString: String, autoString: String; same code as c_script
weightmatrixindexmain = ClusterInput()
weightmatrixindexfilter = ClusterInput()
libpathgrafitrhino = ClusterInput()
timeweightsout = ClusterInput()
edgeislinkundir = ClusterInput()
timeweightsin = ClusterInput()
linegeometry = ClusterInput()
libpathgrafit = ClusterInput()
gpu = ClusterInput()
python_f14_dual_graph_cognitive_distance = GhPythonScript(
    Code=c_script.Code,
    LibPathGrafit=libpathgrafit,
    LibPathGrafitRhino=libpathgrafitrhino,
    LineGeometry=flatten(linegeometry),
    EdgeIsLinkUndir=edgeislinkundir,
    EdgesIsActivityNodeLinkUndir=edgesisactivitynodelinkundir,
    TimeWeightsIn=timeweightsin,
    TimeWeightsOut=timeweightsout,
    WeightMatrixIndexMain=weightmatrixindexmain,
    WeightMatrixIndexFilter=weightmatrixindexfilter,
    GPU=gpu)  # -> Out, DualGraph
dualgraph = ClusterOutput(python_f14_dual_graph_cognitive_distance.DualGraph)

# ==== cluster ClusterPythonF2PrimalDirectedGraph
panel = Panel("Python F2 Primal Directed Graph.py")
pythonsrcfolderpath = ClusterInput()  # PythonSrcFolderPath
c_auto_search = CSharpScript()  # -> out, GrafitPath, GrafitRhinoPath, PythonSrcPath; same code as c_auto_search
concat = Concatenate(FragmentA=pythonsrcfolderpath, FragmentB=panel)
c_script = CSharpScript(file=panel, pythonScrFolderPaht=pythonsrcfolderpath, userString=concat, autoString=c_auto_search.PythonSrcPath)  # -> out, Code; inputs file: String, userString: String, autoString: String; same code as c_script
weightmatrixindexmain = ClusterInput()
weightmatrixindexfilter = ClusterInput()
edgeweightsbackward = ClusterInput()
edgeweightsforward = ClusterInput()
calculateallmatrices = ClusterInput()
libpathgrafitrhino = ClusterInput()
usefiltermatrix = ClusterInput()
linegeometry = ClusterInput()
libpathgrafit = ClusterInput()
gpu = ClusterInput()
python_f2_primal_directed_graph = GhPythonScript(
    Code=c_script.Code,
    LibPathGrafit=libpathgrafit,
    LibPathGrafitRhino=libpathgrafitrhino,
    LineGeometry=linegeometry,
    EdgeWeightsForward=edgeweightsforward,
    EdgeWeightsBackward=edgeweightsbackward,
    WeightMatrixIndexMain=weightmatrixindexmain,
    WeightMatrixIndexFilter=weightmatrixindexfilter,
    CalculateAllMatrices=calculateallmatrices,
    UseFilterMatrix=usefiltermatrix,
    GPU=gpu)  # -> Out, PrimalDirGraph
primaldirgraph = ClusterOutput(python_f2_primal_directed_graph.PrimalDirGraph)

# ==== cluster ClusterPythonF3GetShortestPaths
pythonsrcfolderpath = ClusterInput()  # PythonSrcFolderPath
libpathgrafit = ClusterInput()
libpathgrafitrhino = ClusterInput()
graph = ClusterInput()
origin = ClusterInput()
destination = ClusterInput()
usedirectededges = ClusterInput()
concat = Concatenate(FragmentA=pythonsrcfolderpath, FragmentB="Python F3 Get Shortest Paths.py")
python_f3_get_shortest_paths = GhPythonScript(
    Code=concat,
    LibPathGrafit=libpathgrafit,
    LibPathGrafitRhino=libpathgrafitrhino,
    Graph=graph,
    Origin=origin,
    Destination=destination,
    UseDirectedEdges=usedirectededges)  # -> Out, NodesPath, EdgesPath, Distances
nodespath = ClusterOutput(python_f3_get_shortest_paths.NodesPath)
edgespath = ClusterOutput(python_f3_get_shortest_paths.EdgesPath)
distances = ClusterOutput(python_f3_get_shortest_paths.Distances)

# ==== cluster ClusterPythonF11GetAlternativePaths
pythonsrcfolderpath = ClusterInput()  # PythonSrcFolderPath
libpathgrafit = ClusterInput()
libpathgrafitrhino = ClusterInput()
graph = ClusterInput()
origin = ClusterInput()
destination = ClusterInput()
weightids = ClusterInput()
weighttolerance = ClusterInput()
limit = ClusterInput()
concat = Concatenate(FragmentA=pythonsrcfolderpath, FragmentB="Python F11 Get Alternative Paths.py")
python_f11_get_alternative_paths = GhPythonScript(
    Code=concat,
    LibPathGrafit=libpathgrafit,
    LibPathGrafitRhino=libpathgrafitrhino,
    Graph=graph,
    Origin=origin,
    Destination=destination,
    WeightIds=weightids,
    WeightTolerance=weighttolerance,
    Limit=limit)  # -> Out, NodesPath, EdgesPath
nodespath = ClusterOutput(python_f11_get_alternative_paths.NodesPath)
edgespath = ClusterOutput(python_f11_get_alternative_paths.EdgesPath)

# ==== cluster ClusterPythonF4GenerateGeometry
pythonsrcfolderpath = ClusterInput()  # PythonSrcFolderPath
libpathgrafitrhino = ClusterInput()
libpathgrafit = ClusterInput()
graph = ClusterInput()
concat = Concatenate(FragmentA=pythonsrcfolderpath, FragmentB="Python F4 Generate Geometry.py")
python_f4_generate_geometry = GhPythonScript(Code=concat, LibPathGrafit=libpathgrafit, LibPathGrafitRhino=libpathgrafitrhino, Graph=graph)  # -> Out, NodeAsPoints, EdgesDirected, EdgesUndirected
nodeaspoints = ClusterOutput(python_f4_generate_geometry.NodeAsPoints)
edgesdirected = ClusterOutput(python_f4_generate_geometry.EdgesDirected)
edgesundirected = ClusterOutput(python_f4_generate_geometry.EdgesUndirected)

# ==== cluster ClusterPythonF5GetWeightMatrixAsMatrix
panel = Panel("Python F5 Get Weight Matrix As Matrix.py")
c_auto_search = CSharpScript()  # -> out, GrafitPath, GrafitRhinoPath, PythonSrcPath; same code as c_auto_search
pythonsrcfolderpath = ClusterInput()  # PythonSrcFolderPath
concat = Concatenate(FragmentA=pythonsrcfolderpath, FragmentB=panel)
c_script = CSharpScript(file=panel, pythonScrFolderPaht=pythonsrcfolderpath, userString=concat, autoString=c_auto_search.PythonSrcPath)  # -> out, Code; inputs file: String, userString: String, autoString: String; same code as c_script
libpathgrafit = ClusterInput()
libpathgrafitrhino = ClusterInput()
graph = ClusterInput()
from = ClusterInput()
to = ClusterInput()
weightmatrixindex = ClusterInput()
python_f5_get_weight_matrix_as_matrix = GhPythonScript(
    Code=c_script.Code,
    LibPathGrafit=libpathgrafit,
    LibPathGrafitRhino=libpathgrafitrhino,
    Graph=graph,
    From=from,
    To=to,
    WeightMatrixIndex=weightmatrixindex)  # -> Out, DistanceMatrix
distancematrix = ClusterOutput(python_f5_get_weight_matrix_as_matrix.DistanceMatrix)

# ==== cluster ClusterPythonF7CalculateBCAndCC
panel = Panel("Python F7 Calculate BC and CC.py")
c_auto_search = CSharpScript()  # -> out, GrafitPath, GrafitRhinoPath, PythonSrcPath; same code as c_auto_search
pythonsrcfolderpath = ClusterInput()  # PythonSrcFolderPath
libpathgrafit = ClusterInput()
libpathgrafitrhino = ClusterInput()
graph = ClusterInput()
from = ClusterInput()
to = ClusterInput()
odweightmatrixreduced = ClusterInput()
usedirectededges = ClusterInput()
calculatebc = ClusterInput()
calculatecc = ClusterInput()
ccweightmatrixid = ClusterInput()
gpu = ClusterInput()
concat = Concatenate(FragmentA=pythonsrcfolderpath, FragmentB=panel)
c_script = CSharpScript(file=panel, pythonScrFolderPaht=pythonsrcfolderpath, userString=concat, autoString=c_auto_search.PythonSrcPath)  # -> out, Code; inputs file: String, userString: String, autoString: String; same code as c_script
python_f7_calculate_bc_and_cc = GhPythonScript(
    Code=c_script.Code,
    LibPathGrafit=libpathgrafit,
    LibPathGrafitRhino=libpathgrafitrhino,
    Graph=graph,
    From=from,
    To=to,
    ODWeightMatrixReduced=odweightmatrixreduced,
    UseDirectedEdges=usedirectededges,
    CalculateBC=calculatebc,
    CalculateCC=calculatecc,
    CCWeightMatrixId=ccweightmatrixid,
    GPU=gpu)  # -> Out, BCN, BCE, CCN, CCE
bcn = ClusterOutput(python_f7_calculate_bc_and_cc.BCN)
bce = ClusterOutput(python_f7_calculate_bc_and_cc.BCE)
ccn = ClusterOutput(python_f7_calculate_bc_and_cc.CCN)
cce = ClusterOutput(python_f7_calculate_bc_and_cc.CCE)

# ==== cluster ClusterPythonF13Isovist3DGPU
panel = Panel("Python F13 Isovist 3D.py")
c_auto_search = CSharpScript()  # -> out, GrafitPath, GrafitRhinoPath, PythonSrcPath; same code as c_auto_search
pythonsrcfolderpath = ClusterInput()  # PythonSrcFolderPath
libpathgrafit = ClusterInput()
libpathgrafitrhino = ClusterInput()
vp = ClusterInput()
os = ClusterInput()
gs = ClusterInput()
vd = ClusterInput()
vr = ClusterInput()
hva = ClusterInput()
vva = ClusterInput()
hpr = ClusterInput()
vpr = ClusterInput()
vao = ClusterInput()
ohp = ClusterInput()
concat = Concatenate(FragmentA=pythonsrcfolderpath, FragmentB=panel)
c_script = CSharpScript(file=panel, pythonScrFolderPaht=pythonsrcfolderpath, userString=concat, autoString=c_auto_search.PythonSrcPath)  # -> out, Code; inputs file: String, userString: String, autoString: String; same code as c_script
python_f13_isovist_3d = GhPythonScript(
    Code=c_script.Code,
    LibPathGrafit=libpathgrafit,
    LibPathGrafitRhino=libpathgrafitrhino,
    VP=vp,
    OS=os,
    GS=gs,
    VD=vd,
    VR=vr,
    HVA=hva,
    VVA=vva,
    HPr=hpr,
    VPr=vpr,
    VAO=vao,
    OHP=ohp)  # -> Out, HitPoints, flatten(MeshIdsPerRay), NumberOfRays
hitpoints = ClusterOutput(python_f13_isovist_3d.HitPoints)
meshidsperray = ClusterOutput(python_f13_isovist_3d.MeshIdsPerRay)
numberofrays = ClusterOutput(python_f13_isovist_3d.NumberOfRays)

# ==== cluster ClusterPythonF12CalculatePathVisibility
panel = Panel("Python F12 Calculate Path Visibility.py")
c_auto_search = CSharpScript()  # -> out, GrafitPath, GrafitRhinoPath, PythonSrcPath; same code as c_auto_search
pythonsrcfolderpath = ClusterInput()  # PythonSrcFolderPath
libpathgrafit = ClusterInput()
libpathgrafitrhino = ClusterInput()
graph = ClusterInput()
from = ClusterInput()
to = ClusterInput()
odweightmatrixreduced = ClusterInput()
directed = ClusterInput()
meshidsperray = ClusterInput()
edgetovantagepoints = ClusterInput()
brepscount = ClusterInput()
gpu = ClusterInput()
concat = Concatenate(FragmentA=pythonsrcfolderpath, FragmentB=panel)
c_script = CSharpScript(file=panel, pythonScrFolderPaht=pythonsrcfolderpath, userString=concat, autoString=c_auto_search.PythonSrcPath)  # -> out, Code; inputs file: String, userString: String, autoString: String; same code as c_script
python_f12_calculate_path_visibility = GhPythonScript(
    Code=c_script.Code,
    LibPathGrafit=libpathgrafit,
    LibPathGrafitRhino=libpathgrafitrhino,
    Graph=graph,
    From=from,
    To=to,
    ODWeightMatrixReduced=odweightmatrixreduced,
    Directed=directed,
    MeshIdsPerRay=meshidsperray,
    EdgeToVantagePoints=edgetovantagepoints,
    BrepsCount=brepscount,
    GPU=gpu)  # -> Out, V
V = ClusterOutput(python_f12_calculate_path_visibility.V)

# ==== cluster ClusterPythonF10DisconnectedParts
pythonsrcfolderpath = ClusterInput()  # PythonSrcFolderPath
libpathgrafitrhino = ClusterInput()
libpathgrafit = ClusterInput()
graph = ClusterInput()
concat = Concatenate(FragmentA=pythonsrcfolderpath, FragmentB="Python F10 DisconnectedParts.py")
python_f10_disconnectedparts = GhPythonScript(Code=concat, LibPathGrafit=libpathgrafit, LibPathGrafitRhino=libpathgrafitrhino, Graph=graph)  # -> Out, Subgraphs
subgraphs = ClusterOutput(python_f10_disconnectedparts.Subgraphs)
